# Grasshopper definition 4_AnnualWindAnalysis.ghx (Grasshopper 1.0.7)
# plug-ins: VirtualWindTunnel

# C:\Users\pkastner\Google Drive\Patrick\Papers\CPGenerator\Conference\Data\Weather\AUS_NT.Tennant.Creek.942380_RMY.epw
panel = Panel("C:\Users\pkastner\Google Drive\Patrick\Papers\CPGenerator\Conference\Data\Weather\AUS_NSW.Dubbo.Airport.957190_RMY.epw")

# ----
# 1. Geometry &
# Boundary Conditions
# C:\DIVA\WeatherData\USA_IL_Chicago-OHare.Intl.AP.725300_TMY3.epw
panel_2 = Panel("""0
45
90
135
180
225
270
315""")
abl = ABL(WDir=panel_2, Uref="10", Zref=10, Z0=1, ZGround=0, Epw=panel)
geo = Geometry([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])

# ----
# 2. Simulation Domain
number_slider = Slider(50, range=0..1000)
domaincyl = CylindricalDomain(
    Geometry=geo,
    BCond=abl,
    BlockSize="10",
    SizeOfInnerRectangle=number_slider,
    SizeOfOuterRadius=Slider(300, range=0..1000),
    Height=Slider(80, range=0..1000))  # -> Domain, Mesh

# ----
# 3. Mesh & Simulation
panel_3 = Panel("3")
mset = MeshSettings(AccBuilding=2, AccFeatures=panel_3, AccRefinement=0, AccGround=2, NLayer=3, Mode=1)
rset = RunSettings(
    Iterations="100",
    WriteInterval=20,
    KeepTimeSteps=2,
    Turbulence=1,
    RelaxationFactors=0,
    Mode=0,
    CPUs="3",
    OperationSystem=0)
simulation = Simulation(
    SimulationDomain=domaincyl.Domain,
    WorkingDirectory="C:\test_cyl",
    MeshSettings=mset,
    RunSettings=rset,
    RunMeshing=Button(),
    RunSimulation=Button(),
    runWithBlueCFD=True)

residuals = Residuals(Result=simulation, SelectionOfWindDirections="0", X=":", Y=":", Version=1, Run=Button(), visResiduals=False)

# ----
# 4. Probing points & probing
number_slider_2 = Slider(6, range=1..50)
brep = Brep(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)
meshplane = MeshPlane(brep=brep, number=number_slider_2)  # -> vertices, faces
visprobes = VisualizeProbes(Result=simulation, ProbingPoints=meshplane.vertices, NameOfInstance="cyl", NameOfField=0, Run=Button(), Culling=True)  # -> PorbingPoints, ProbingResult

# ----
# 6. Clean
button = Button()
clean = Clean(Directory=simulation, Mode=2, Run=button)

# ----
# 5. Post-processing
# 5.1. Paraview
# 5.2. Grasshopper
button_2 = Button()
dir = Slider(0, range=0..7)
# 5.3. Grasshopper
button_3 = Button()
vectors = Data(visprobes.ProbingResult)
points = Data(visprobes.PorbingPoints)
paraview = Paraview(Result=simulation, ParaviewVersion=2, Run=button_2)
# Multi-directional / annual wind vectors
choose_dir = TreeBranch(Tree=vectors, Path=dir, MaintainPaths=True)
# Pedestrian wind comfort
windfactors = WindFactors(Result=simulation, ProbingPoints=points, U=vectors, Run=button_3, Interpolation=True)  # -> WindFactors, LawsonPedestrianComfort, DavenportPedestrianComfort, NEN8100PedestrianComfort, OffSet
# Pedestrian wind comfort (Lawson)
# Pedestrian wind comfort (Davenport)
panel_4 = Panel("200")
# Pedestrian wind comfort (NEN 8100)
panel_5 = Panel("400")
Y = UnitY(Factor=panel_4)
Y_2 = UnitY(Factor="600")
Y_3 = UnitY(Factor=panel_5)
cluster = Cluster(data=choose_dir)  # -> S, E, data_3
move = Move(Geometry=geo, Motion=Y)  # -> Geometry, Transform
move_2 = Move(Geometry=geo, Motion=Y_2)  # -> Geometry, Transform
cluster_2 = Cluster_3(C=points, T=Y)
move_3 = Move(Geometry=geo, Motion=Y_3)  # -> Geometry, Transform
cluster_3 = Cluster_4(C=points, T=Y_2)
cluster_4 = Cluster_4(C=points, T=Y_3)
gradient = Gradient(
    LowerLimit=cluster.S,
    UpperLimit=Slider(8, range=0..10),
    Parameter=cluster.data_3,
    stops=[0.103: RGB(0, 0, 255), 0.22: RGB(0, 170, 255), 0.305: RGB(0, 255, 255), 0.398: RGB(0, 255, 188), 0.504: RGB(0, 255, 106), 0.605: RGB(91, 255, 0), 0.699: RGB(184, 255, 0), 0.799: RGB(255, 255, 0), 0.898: RGB(255, 170, 0)])
dedata = DeconstructData(Data=windfactors.WindFactors)
cluster_5 = Cluster(data=windfactors.LawsonPedestrianComfort)  # -> S, E, data_3
cluster_6 = Cluster(data=windfactors.NEN8100PedestrianComfort)  # -> S, E, data_3
cluster_7 = Cluster(data=windfactors.DavenportPedestrianComfort)  # -> S, E, data_3
flip = FlipMatrix(Data=dedata)
gradient_2 = Gradient(
    LowerLimit=cluster_5.S,
    UpperLimit=cluster_5.E,
    Parameter=cluster_5.data_3,
    stops=[0.103: RGB(0, 0, 255), 0.22: RGB(0, 170, 255), 0.305: RGB(0, 255, 255), 0.398: RGB(0, 255, 188), 0.504: RGB(0, 255, 106), 0.605: RGB(91, 255, 0), 0.699: RGB(184, 255, 0), 0.799: RGB(255, 255, 0), 0.898: RGB(255, 170, 0)])
gradient_3 = Gradient(
    LowerLimit=cluster_6.S,
    UpperLimit=cluster_6.E,
    Parameter=cluster_6.data_3,
    stops=[0.103: RGB(0, 0, 255), 0.22: RGB(0, 170, 255), 0.305: RGB(0, 255, 255), 0.398: RGB(0, 255, 188), 0.504: RGB(0, 255, 106), 0.605: RGB(91, 255, 0), 0.699: RGB(184, 255, 0), 0.799: RGB(255, 255, 0), 0.898: RGB(255, 170, 0)])
gradient_4 = Gradient(
    LowerLimit=cluster_7.S,
    UpperLimit=cluster_7.E,
    Parameter=cluster_7.data_3,
    stops=[0.103: RGB(0, 0, 255), 0.22: RGB(0, 170, 255), 0.305: RGB(0, 255, 255), 0.398: RGB(0, 255, 188), 0.504: RGB(0, 255, 106), 0.605: RGB(91, 255, 0), 0.699: RGB(184, 255, 0), 0.799: RGB(255, 255, 0), 0.898: RGB(255, 170, 0)])
avr = Average(Input=flip)  # -> flatten(ArithmeticMean)
vdisex = VectorDisplayEx(Point=points, Vector=choose_dir, Colour=gradient, Width=Slider(3, range=0..10))
cluster_8 = Cluster(data=avr)  # -> S, E, data_3
gradient_5 = Gradient(
    LowerLimit=cluster_8.S,
    UpperLimit=cluster_8.E,
    Parameter=cluster_8.data_3,
    stops=[0.103: RGB(0, 0, 255), 0.22: RGB(0, 170, 255), 0.305: RGB(0, 255, 255), 0.398: RGB(0, 255, 188), 0.504: RGB(0, 255, 106), 0.605: RGB(91, 255, 0), 0.699: RGB(184, 255, 0), 0.799: RGB(255, 255, 0), 0.898: RGB(255, 170, 0)])
preview = CustomPreview(Geometry=cluster_2, Material=gradient_2)
preview_2 = CustomPreview(Geometry=cluster_3, Material=gradient_3)
preview_3 = CustomPreview(Geometry=cluster_4, Material=gradient_4)
cluster_9 = Cluster_2(C=points)
preview_4 = CustomPreview(Geometry=cluster_9, Material=gradient_5)

# ==== cluster MeshPlane
number = ClusterInput()
number_2 = Number(number)
settings_custom = SettingsCustom(
    StitchSeams=True,
    SimplePlanes=False,
    Refine=True,
    MinCount=16,
    MaxCount=400,
    AspectRatio=20,
    MaxDistance=0,
    MaxAngle=20,
    MinEdge=number_2,
    MaxEdge=number_2)
brep = ClusterInput()
mesh_brep = MeshBrep(Brep=brep, Settings=settings_custom)
deconstruct_mesh = DeconstructMesh(Mesh=mesh_brep)  # -> Vertices, Faces, Colours, Normals
faces = ClusterOutput(deconstruct_mesh.Faces)
vertices = ClusterOutput(deconstruct_mesh.Vertices)

# ==== cluster Cluster
data = ClusterInput()
data_2 = Data(data)
data_3 = ClusterOutput(data_2)
bnd = Bounds(Numbers=data_2)
dedomain = DeconstructDomain(Domain=bnd)  # -> Start, End
S = ClusterOutput(dedomain.Start)
E = ClusterOutput(dedomain.End)

# ==== cluster Cluster_2
C = ClusterInput()
circle = CircleCNR(Center=C, Normal=Vector(0, 0, 1), Radius=2)
srf = Surface(circle)
srf_2 = ClusterOutput(srf)

# ==== cluster Cluster_3
T = ClusterInput()
C = ClusterInput()
cluster = Cluster_2(C=C)
move = Move(Geometry=cluster, Motion=T)  # -> Geometry, Transform
G = ClusterOutput(move.Geometry)

# ==== cluster Cluster_4
C = ClusterInput()
T = ClusterInput()
cluster = Cluster_2(C=C)
move = Move(Geometry=cluster, Motion=T)  # -> Geometry, Transform
G = ClusterOutput(move.Geometry)
